# Grasshopper definition Ecology_Driven.gh (Grasshopper 1.0.7)
# plug-ins: Bifocals, Anemone

number_slider = Slider(3, range=0..10)
construct_domain = ConstructDomain(DomainStart=0, DomainEnd=number_slider)
number_slider_2 = Slider(20, range=0..100)
rectangle = Rectangle(Plane=PlaneXY(0, 0, 0), XSize=construct_domain, YSize=construct_domain, Radius=0)  # -> Rectangle, Length
point = Point(Point(97.88640674, -91.87872217, 0))
rectangular_array = RectangularArray(Geometry=point, Cell=rectangle.Rectangle, XCount=number_slider_2, YCount=number_slider_2)  # -> Geometry, Transform
pln = Plane(rectangular_array.Geometry)
list_length = ListLength(List=rectangular_array.Geometry)
area = Area(Geometry=pln)  # -> Area, Centroid
proximity_2d = Proximity2D(Points=rectangular_array.Geometry, Plane=PlaneXY(0, 0, 0), Group="8", MaxRadius=expr("x*1.5", number_slider))  # -> Links, Topology

# ---- group: Generate Random Type and Height
random = Random(Range="0 to 2", Number=list_length, Seed=Slider(4, range=0..10), Integers=True)
random_2 = Random(Range="-5 to 10", Number=list_length, Seed=Slider(2, range=0..10), Integers=True)
height = Integer(random_2)
type = Integer(random)

# ----
number_slider_3 = Slider(63, range=0..100)
number_slider_4 = Slider(60, range=0..100)
rectangle_2 = Rectangle(Plane=point, XSize=number_slider_3, YSize=number_slider_3, Radius=0)  # -> Rectangle, Length
vec = VectorXYZ(XComponent=Slider(-3, range=-20..21), YComponent=Slider(-3, range=-20..21), ZComponent=0)  # -> Vector, Length
vec_2 = VectorXYZ(XComponent=Slider(-1.5, range=-20..21), YComponent=Slider(-1.5, range=-20..21), ZComponent=0)  # -> Vector, Length
rectangle_3 = Rectangle(Plane=point, XSize=number_slider_4, YSize=number_slider_4, Radius=0)  # -> Rectangle, Length
move = Move(Geometry=rectangle_3.Rectangle, Motion=vec_2.Vector)  # -> Geometry, Transform
move_2 = Move(Geometry=rectangle_2.Rectangle, Motion=vec.Vector)  # -> Geometry, Transform
number_slider_5 = Slider(0, range=0..100)
merge = Merge(Data1=move.Geometry, Data2=move_2.Geometry)
pcen = PolygonCenter(Polyline=move.Geometry)  # -> CenterV, CenterE, CenterA
loft = Loft(Curves=merge, Options={Adjust=False, Closed=False, LoftEnds=0, LoftSimp=0, LoftType=0, Rebuild=10, Refit=0.01})
vec_3 = VectorXYZ(XComponent=number_slider_5, YComponent=number_slider_5, ZComponent=Slider(-5, range=-20..21))  # -> Vector, Length
extr = Extrude(Base=loft, Direction=vec_3.Vector)
custom_preview = CustomPreview(Geometry=extr, Material=ColourSwatch(SwatchColor=RGB(117, 116, 116)))

pt = Point(pcen.CenterV)

construct_domain_2 = ConstructDomain(DomainStart=Slider(-1.5, range=-2..3), DomainEnd=Slider(1.5, range=0..10))
construct_domain_3 = ConstructDomain(DomainStart=Slider(-1, range=-2..3), DomainEnd=Slider(1, range=0..10))

loop_start = LoopStart(Repeat="10", Trigger=Button(), Type=type, Height=height)  # -> port, Counter, Data, Height

list_item = ListItem(List=loop_start.Data, Index=proximity_2d.Topology, Wrap=True)

# ---- group: Count Surrounding Type
c_script = CSharpScript(Surround_Value=list_item)  # -> C0, C1, C2; inputs Surround_Value: list of Int32
# ---------- c_script: C# ----------
    int count0 = 0;
    int count1 = 0;
    int count2 = 0;

    for (int i = 0 ; i < Surround_Value.Count; i++)
    { if( Surround_Value[i] == 0)
      { count0++;}
      if( Surround_Value[i] == 1)
      { count1++;}
      if ( Surround_Value[i] == 2)
      { count2++;}

    }
    C0 = count0;
    C1 = count1;
    C2 = count2;
# ---------- end c_script ----------

# ----
num = Number(flatten(c_script.C2))
num_2 = Number(flatten(c_script.C1))
num_3 = Number(flatten(c_script.C0))
c_script_2 = CSharpScript(Count0=num_3, Count1=num_2, Count2=num, Type=loop_start.Data, Height=loop_start.Height)  # -> out, NewType, NewHeight; inputs Count0: list of Int32, Count1: list of Int32, Count2: list of Int32, Type: list of Int32, Height: list of Double
# ---------- c_script_2: C# ----------
    for (int i = 0; i < Type.Count; i++){

      if ( Type[i] == 0 && Count0[i] <= 2 && Count1[i] <= 2)
      {
        Type[i] = 2;
        Height[i] = Height[i] + 1.5;}
      if ( Type[i] == 0 && Count0[i] <= 2 && Count1[i] > 2  )
      {
        Type[i] = 1;
        Height[i] = Height[i] + 0.7;}
      if ( Type[i] == 0 && Count0[i] > 2 && Count0[i] <= 4 && Count1[i] <= 2)
      {
        Type[i] = 2;
        Height[i] = Height[i] / 1.1; }
      if ( Type[i] == 0 && Count0[i] > 2 && Count0[i] <= 4 && Count1[i] > 2 )
      {
        Type[i] = 2;
        Height[i] = Height[i] / 1.3; }

      if ( Type[i] == 0 && Count0[i] > 4 && Count1[i] <= 2)
      {
        Type[i] = 2;
        Height[i] = Height[i] / 1.1; }

      if ( Type[i] == 0 && Count0[i] > 4 && Count1[i] > 2)
      {
        Type[i] = 2;
        Height[i] = Height[i] / 1.3; }




      if ( Type[i] == 1 && Count0[i] <= 2 && Count1[i] <= 2)
      {
        Type[i] = 2;
        Height[i] = Height[i] + 0.5;}

      if ( Type[i] == 1 && Count0[i] <= 2 && Count1[i] > 2)
      {
        Type[i] = 0;
        Height[i] = Height[i] + 1;}
      if ( Type[i] == 1 && Count0[i] > 2 && Count0[i] <= 4 && Count1[i] <= 2)
      {
        Type[i] = 2;
        Height[i] = Height[i] / 1.5;}
      if ( Type[i] == 1 && Count0[i] > 2 && Count0[i] <= 4 && Count1[i] > 2)
      {
        Type[i] = 2;
        Height[i] = Height[i];}

      if ( Type[i] == 1 && Count0[i] > 4 && Count1[i] <= 2)
      {
        Type[i] = 2;
        Height[i] = Height[i] / 1.2;}
      if ( Type[i] == 1 && Count0[i] > 4 && Count1[i] > 2)
      {
        Type[i] = 2;
        Height[i] = Height[i] / 1.4;}


      if ( Type[i] == 2 && Count0[i] <= 2 && Count1[i] <= 2)
      {
        Type[i] = 1;
        Height[i] = Height[i] / 1.1;}
      if ( Type[i] == 2 && Count0[i] <= 2 && Count1[i] > 2)
      {
        Type[i] = 2;
        Height[i] = Height[i] / 1.2;}
      if ( Type[i] == 2 && Count0[i] > 2 && Count0[i] <= 4 && Count1[i] <= 2)
      {
        Type[i] = 2;
        Height[i] = Height[i] + 0.5;}
      if ( Type[i] == 2 && Count0[i] > 2 && Count0[i] <= 4 && Count1[i] > 2)
      {
        Type[i] = 1;
        Height[i] = Height[i] + 1;}
      if ( Type[i] == 2 && Count0[i] > 4 && Count1[i] <= 2)
      {
        Type[i] = 0;
        Height[i] = Height[i] / 1.2;}
      if ( Type[i] == 2 && Count0[i] > 2 && Count0[i] > 2)
      {
        Type[i] = 2;
        Height[i] = Height[i] / 1.1;}


      if ( Height[i] > 20)
      {
        Type[i] = 0;
        Height[i] = Height[i] / 2;}

      if ( Height[i] < 0.5)
      {
        Type[i] = 2;
        Height[i] = Height[i] / 2;}





      /*if ( Type[i] == 0 && Count0[i] <= 2 && Count1[i] <= 2)
      {
        Type[i] = 0;
        Height[i] = Height[i] + 2;}
      if ( Type[i] == 0 && Count0[i] <= 2 && Count1[i] > 2  )
      {
        Type[i] = 2;
        Height[i] = Height[i] + 1;}
      if ( Type[i] == 0 && Count0[i] > 2 && Count0[i] <= 4 && Count1[i] <= 2)
      {
        Type[i] = 1;
        Height[i] = Height[i] / 2; }
      if ( Type[i] == 0 && Count0[i] > 2 && Count0[i] <= 4 && Count1[i] > 2 )
      {
        Type[i] = 0;
        Height[i] = Height[i] / 4; }

      if ( Type[i] == 0 && Count0[i] > 4 && Count1[i] <= 2)
      {
        Type[i] = 2;
        Height[i] = Height[i] + 1; }

      if ( Type[i] == 0 && Count0[i] > 4 && Count1[i] > 2)
      {
        Type[i] = 2;
        Height[i] = Height[i] / 2; }




      if ( Type[i] == 1 && Count0[i] <= 2 && Count1[i] <= 2)
      {
        Type[i] = 0;
        Height[i] = Height[i] + 4;}

      if ( Type[i] == 1 && Count0[i] <= 2 && Count1[i] > 2)
      {
        Type[i] = 2;
        Height[i] = Height[i] + 1;}
      if ( Type[i] == 1 && Count0[i] > 2 && Count0[i] <= 4 && Count1[i] <= 2)
      {
        Type[i] = 0;
        Height[i] = Height[i] / 2;}
      if ( Type[i] == 1 && Count0[i] > 2 && Count0[i] <= 4 && Count1[i] > 2)
      {
        Type[i] = 2;
        Height[i] = Height[i];}

      if ( Type[i] == 1 && Count0[i] > 4 && Count1[i] <= 2)
      {
        Type[i] = 1;
        Height[i] = Height[i] + 2;}
      if ( Type[i] == 1 && Count0[i] > 4 && Count1[i] > 2)
      {
        Type[i] = 2;
        Height[i] = Height[i] / 4;}


      if ( Type[i] == 2 && Count0[i] <= 2 && Count1[i] <= 2)
      {
        Type[i] = 0;
        Height[i] = Height[i] + 4;}
      if ( Type[i] == 2 && Count0[i] <= 2 && Count1[i] > 2)
      {
        Type[i] = 0;
        Height[i] = Height[i] / 2;}
      if ( Type[i] == 2 && Count0[i] > 2 && Count0[i] <= 4 && Count1[i] <= 2)
      {
        Type[i] = 0;
        Height[i] = Height[i];}
      if ( Type[i] == 2 && Count0[i] > 2 && Count0[i] <= 4 && Count1[i] > 2)
      {
        Type[i] = 2;
        Height[i] = Height[i] + 1;}
      if ( Type[i] == 2 && Count0[i] > 4 && Count1[i] <= 2)
      {
        Type[i] = 1;
        Height[i] = Height[i] / 4;}
      if ( Type[i] == 2 && Count0[i] > 2 && Count0[i] > 2)
      {
        Type[i] = 2;
        Height[i] = Height[i] / 2;}
*/


      /*if ( Height[i] > 45 && Type[i] == 1)
      {
        Type[i] = 2;
        Height[i] = Height[i] / 5; }
      if ( Height[i] > 30 && Type[i] == 2)
      {
        Type[i] = 0;
        Height[i] = Height[i] / 4; }
      if ( Height[i] > 15 && Type[i] == 0)
      {
        Type[i] = 2;
        Height[i] = Height[i] / 3; }
      if ( Height[i] < -35 && Type[i] == 1)
      {
        Type[i] = 0;
        Height[i] = Height[i] / 5; }
      if ( Height[i] < -20 && Type[i] == 0)
      {
        Type[i] = 2;
        Height[i] = Height[i] / 4; }
      if ( Height[i] < -15 && Type[i] == 2)
      {
        Type[i] = 1;
        Height[i] = Height[i] / 3; }
 */




    }

    NewType = Type;
    NewHeight = Height;
# ---------- end c_script_2 ----------
num_4 = Number(c_script_2.NewType)

loop_end = LoopEnd(
    port=loop_start.port,
    Exit=False,
    Data=num_4,
    Height=c_script_2.NewHeight,
    TimeOutVal=0,
    pausedState=False,
    state="Constant output")  # -> Type, Height

sift = SiftPattern(List=rectangular_array.Geometry, SiftPattern=loop_end.Type)  # -> Output0, Output1, Output2
sift_2 = SiftPattern(List=loop_end.Height, SiftPattern=loop_end.Type)  # -> Output0, Output1, Output2

number_slider_6 = Slider(0, range=0..100)
clean = CleanTree(RemoveNulls=True, RemoveInvalid=True, RemoveEmpty=True, Tree=sift_2.Output1)
multiplication = Multiplication(A=clean, B=Slider(1.2, range=0..10))
vec_4 = VectorXYZ(XComponent=number_slider_6, YComponent=number_slider_6, ZComponent=multiplication)  # -> Vector, Length
cull = CullPattern(List=area.Centroid, CullPattern=sift_2.Output1)
move_3 = Move(Geometry=cull, Motion=vec_4.Vector)  # -> Geometry, Transform
pt_2 = Point(pt)
del = DelaunayMesh(Points=move_3.Geometry, Plane=PlaneXY(0, 0, 0))
scale = Scale(Geometry=del, Center=pt_2, Factor=Slider(0.8, range=0..1))  # -> Geometry, Transform
vec_5 = VectorXYZ(
    XComponent=Slider(73, range=-100..100.001),
    YComponent=Slider(-15, range=-100..100.001),
    ZComponent=Slider(-8.049, range=-70..70.001))  # -> Vector, Length
demesh = DeconstructMesh(Mesh=scale.Geometry)  # -> Vertices, Faces, Colours, Normals
medges = MeshEdges(Mesh=scale.Geometry)  # -> NakedEdges, InteriorEdges, NonManifoldEdges
move_4 = Move(Geometry=scale.Geometry, Motion=vec_5.Vector)  # -> Geometry, Transform
pdecon = Deconstruct(Point=demesh.Vertices)  # -> XComponent, YComponent, ZComponent
bnd = Bounds(Numbers=pdecon.ZComponent)
merge_2 = Merge(Data1=medges.NakedEdges, Data2=medges.InteriorEdges)
remap = RemapNumbers(Value=pdecon.ZComponent, Source=bnd, Target=Domain(0, 1))  # -> simplify(Mapped), Clipped
line = Line(merge_2)
gradient = Gradient(
    LowerLimit=Slider(0, range=0..100),
    UpperLimit=Slider(1, range=0..1),
    Parameter=remap.Mapped,
    stops=[0: RGB(192, 192, 255), 0.955: RGB(0, 0, 128)])
vec_6 = VectorXYZ(
    XComponent=Slider(73, range=-100..100.001),
    YComponent=Slider(-15, range=-100..100.001),
    ZComponent=Slider(-8.049, range=-70..70.001))  # -> Vector, Length
move_5 = Move(Geometry=line, Motion=vec_6.Vector)  # -> Geometry, Transform
mcol = MeshColours(Mesh=move_4.Geometry, Colours=gradient)
preview = CustomPreview(Geometry=move_5.Geometry, Material=ColourSwatch(SwatchColor=RGB(227, 229, 232)))

number_slider_7 = Slider(0, range=0..100)
clean_2 = CleanTree(RemoveNulls=True, RemoveInvalid=True, RemoveEmpty=True, Tree=sift_2.Output0)
multiplication_2 = Multiplication(A=clean_2, B=Slider(1.2, range=0..10))
vec_7 = VectorXYZ(XComponent=number_slider_7, YComponent=number_slider_7, ZComponent=multiplication_2)  # -> Vector, Length
cull_2 = CullPattern(List=area.Centroid, CullPattern=sift_2.Output0)
move_6 = Move(Geometry=cull_2, Motion=vec_7.Vector)  # -> Geometry, Transform
pt_3 = Point(pt)
del_2 = DelaunayMesh(Points=move_6.Geometry, Plane=PlaneXY(0, 0, 0))
vec_8 = VectorXYZ(
    XComponent=Slider(73.567, range=-100..100.001),
    YComponent=Slider(-15, range=-100..100.001),
    ZComponent=Slider(43.177, range=-200..200.001))  # -> Vector, Length
scale_2 = Scale(Geometry=del_2, Center=pt_3, Factor=Slider(0.8, range=0..1))  # -> Geometry, Transform
move_7 = Move(Geometry=scale_2.Geometry, Motion=vec_8.Vector)  # -> Geometry, Transform
medges_2 = MeshEdges(Mesh=scale_2.Geometry)  # -> NakedEdges, InteriorEdges, NonManifoldEdges
demesh_2 = DeconstructMesh(Mesh=scale_2.Geometry)  # -> Vertices, Faces, Colours, Normals
pdecon_2 = Deconstruct(Point=demesh_2.Vertices)  # -> XComponent, YComponent, ZComponent
merge_3 = Merge(Data1=medges_2.NakedEdges, Data2=medges_2.InteriorEdges)
bnd_2 = Bounds(Numbers=pdecon_2.ZComponent)
line_2 = Line(merge_3)
remap_2 = RemapNumbers(Value=pdecon_2.ZComponent, Source=bnd_2, Target=Domain(0, 1))  # -> simplify(Mapped), Clipped
gradient_2 = Gradient(
    LowerLimit=Slider(0, range=0..100),
    UpperLimit=Slider(1, range=0..1),
    Parameter=remap_2.Mapped,
    stops=[0: RGB(255, 130, 160), 0.961: RGB(220, 0, 40)])
vec_9 = VectorXYZ(
    XComponent=Slider(73.567, range=-100..100.001),
    YComponent=Slider(-15, range=-100..100.001),
    ZComponent=Slider(43.177, range=-200..200.001))  # -> Vector, Length
move_8 = Move(Geometry=line_2, Motion=vec_9.Vector)  # -> Geometry, Transform
mcol_2 = MeshColours(Mesh=move_7.Geometry, Colours=gradient_2)
preview_2 = CustomPreview(Geometry=move_8.Geometry, Material=ColourSwatch(SwatchColor=RGB(227, 229, 232)))

number_slider_8 = Slider(0, range=0..100)
clean_3 = CleanTree(RemoveNulls=True, RemoveInvalid=True, RemoveEmpty=True, Tree=sift_2.Output0)
multiplication_3 = Multiplication(A=clean_3, B=Slider(0.3, range=0..1))
vec_10 = VectorXYZ(XComponent=number_slider_8, YComponent=number_slider_8, ZComponent=multiplication_3)  # -> Vector, Length
cull_3 = CullPattern(List=area.Centroid, CullPattern=sift_2.Output0)
move_9 = Move(Geometry=cull_3, Motion=vec_10.Vector)  # -> Geometry, Transform
pt_4 = Point(pt)
del_3 = DelaunayMesh(Points=move_9.Geometry, Plane=PlaneXY(0, 0, 0))
vec_11 = VectorXYZ(
    XComponent=Slider(75, range=-100..100.001),
    YComponent=Slider(-15, range=-100..100.001),
    ZComponent=Slider(-50.714, range=-200..200.001))  # -> Vector, Length
scale_3 = Scale(Geometry=del_3, Center=pt_4, Factor=Slider(0.8, range=0..1))  # -> Geometry, Transform
medges_3 = MeshEdges(Mesh=scale_3.Geometry)  # -> NakedEdges, InteriorEdges, NonManifoldEdges
demesh_3 = DeconstructMesh(Mesh=scale_3.Geometry)  # -> Vertices, Faces, Colours, Normals
move_10 = Move(Geometry=scale_3.Geometry, Motion=vec_11.Vector)  # -> Geometry, Transform
merge_4 = Merge(Data1=medges_3.NakedEdges, Data2=medges_3.InteriorEdges)
pdecon_3 = Deconstruct(Point=demesh_3.Vertices)  # -> XComponent, YComponent, ZComponent
bnd_3 = Bounds(Numbers=pdecon_3.ZComponent)
line_3 = Line(merge_4)
remap_3 = RemapNumbers(Value=pdecon_3.ZComponent, Source=bnd_3, Target=Domain(0, 1))  # -> simplify(Mapped), Clipped
gradient_3 = Gradient(
    LowerLimit=Slider(0, range=0..100),
    UpperLimit=Slider(1, range=0..1),
    Parameter=remap_3.Mapped,
    stops=[0: RGB(0, 128, 0), 0.707: RGB(192, 255, 192)])
vec_12 = VectorXYZ(
    XComponent=Slider(75, range=-100..100.001),
    YComponent=Slider(-15, range=-100..100.001),
    ZComponent=Slider(-50.714, range=-200..200.001))  # -> Vector, Length
move_11 = Move(Geometry=line_3, Motion=vec_12.Vector)  # -> Geometry, Transform
mcol_3 = MeshColours(Mesh=move_10.Geometry, Colours=gradient_3)
preview_3 = CustomPreview(Geometry=move_11.Geometry, Material=ColourSwatch(SwatchColor=RGB(227, 229, 232)))

construct_domain_4 = ConstructDomain(DomainStart=Slider(-1.5, range=-2..3), DomainEnd=Slider(1.5, range=0..10))
construct_domain_5 = ConstructDomain(DomainStart=Slider(-0.5, range=-2..3), DomainEnd=Slider(0.5, range=0..1))
plane_surface = PlaneSurface(Plane=sift.Output0, XSize=construct_domain_5, YSize=construct_domain_5)
plane_surface_2 = PlaneSurface(Plane=sift.Output0, XSize=construct_domain_4, YSize=construct_domain_4)
boxrec = BoxRectangle(Rectangle=plane_surface, Height=sift_2.Output0)
custom_preview_2 = CustomPreview(Geometry=plane_surface_2, Material=ColourSwatch(SwatchColor=RGB(222, 144, 158)))
custom_preview_3 = CustomPreview(Geometry=boxrec, Material=ColourSwatch(SwatchColor=RGB(219, 35, 50)))

construct_domain_6 = ConstructDomain(DomainStart=Slider(-1.5, range=-2..3), DomainEnd=Slider(1.5, range=0..10))
construct_domain_7 = ConstructDomain(DomainStart=Slider(-0.5, range=-2..3), DomainEnd=Slider(0.5, range=0..1))
plane_surface_3 = PlaneSurface(Plane=sift.Output1, XSize=construct_domain_6, YSize=construct_domain_6)
plane_surface_4 = PlaneSurface(Plane=sift.Output1, XSize=construct_domain_7, YSize=construct_domain_7)
boxrec_2 = BoxRectangle(Rectangle=plane_surface_4, Height=sift_2.Output1)
custom_preview_4 = CustomPreview(Geometry=plane_surface_3, Material=ColourSwatch(SwatchColor=RGB(186, 186, 214)))
custom_preview_5 = CustomPreview(Geometry=boxrec_2, Material=ColourSwatch(SwatchColor=RGB(104, 104, 173)))

number_slider_9 = Slider(0, range=0..100)
plane_surface_5 = PlaneSurface(Plane=sift.Output2, XSize=construct_domain_3, YSize=construct_domain_3)
multiplication_4 = Multiplication(A=sift_2.Output2, B=Slider(-0.2, range=-2..3))
vec_13 = VectorXYZ(XComponent=number_slider_9, YComponent=number_slider_9, ZComponent=multiplication_4)  # -> Vector, Length
move_12 = Move(Geometry=plane_surface_5, Motion=vec_13.Vector)  # -> Geometry, Transform
custom_preview_6 = CustomPreview(Geometry=move_12.Geometry, Material=ColourSwatch(SwatchColor=RGB(70, 87, 48)))

rectangle_4 = Rectangle(Plane=sift.Output2, XSize=construct_domain_2, YSize=construct_domain_2, Radius=0)  # -> Rectangle, Length
rectangle_5 = Rectangle(Plane=sift.Output2, XSize=construct_domain_3, YSize=construct_domain_3, Radius=0)  # -> Rectangle, Length
rec = Rectangle(graft(rectangle_4.Rectangle))
rec_2 = Rectangle(graft(rectangle_5.Rectangle))
merge_5 = Merge(Data1=rec, Data2=rec_2)
clean_4 = CleanTree(RemoveNulls=True, RemoveInvalid=True, RemoveEmpty=True, Tree=merge_5)
loft_2 = Loft(Curves=clean_4, Options={Adjust=False, Closed=False, LoftEnds=0, LoftSimp=0, LoftType=0, Rebuild=10, Refit=0.01})
custom_preview_7 = CustomPreview(Geometry=loft_2, Material=ColourSwatch(SwatchColor=RGB(150, 173, 120)))

number_slider_10 = Slider(0, range=0..100)
multiplication_5 = Multiplication(A=sift_2.Output2, B=Slider(-0.2, range=-2..3))
vec_14 = VectorXYZ(XComponent=number_slider_10, YComponent=number_slider_10, ZComponent=multiplication_5)  # -> Vector, Length
extr_2 = Extrude(Base=rectangle_5.Rectangle, Direction=vec_14.Vector)
custom_preview_8 = CustomPreview(Geometry=extr_2, Material=ColourSwatch(SwatchColor=RGB(150, 173, 120)))
